# Grasshopper definition sphere_box.gh (Grasshopper 1.0.7)

boxlength = GetNumber(Slider(10, range=0..10), AtLeast=1, AtMost=1, Maximum=1.797693135e+308, Minimum=-1.797693135e+308, TreeAccess=False)
boxwidth = GetNumber(Slider(10, range=0..10), AtLeast=1, AtMost=1, Maximum=1.797693135e+308, Minimum=-1.797693135e+308, TreeAccess=False)
boxheight = GetNumber(Slider(10, range=0..10), AtLeast=1, AtMost=1, Maximum=1.797693135e+308, Minimum=-1.797693135e+308, TreeAccess=False)
numpoints = GetInteger(Slider(100, range=0..100), AtLeast=1, AtMost=1, Maximum=2147483647, Minimum=-2147483648, TreeAccess=False)
sphereradius = GetNumber(
    Slider(1, range=0..1),
    AtLeast=1,
    AtMost=1,
    Maximum=1.797693135e+308,
    Minimum=-1.797693135e+308,
    Prompt="SPHERE RADIUS",
    TreeAccess=False)
center_box = CenterBox(Base=PlaneXY(0, 0, 0), X=boxlength, Y=boxwidth, Z=boxheight)
populate_3d = Populate3D(Region=center_box, Count=numpoints, Seed=1)
brep_wireframe = BrepWireframe(Brep=center_box, Density=-1)
sphere = Sphere(Base=populate_3d, Radius=sphereradius)
curve = Curve(brep_wireframe)
mesh_brep = MeshBrep(
    Brep=sphere,
    Settings={GridMaxCount=0, GridMinCount=16, JaggedSeams=False, MaxEdgeLength=0, MinEdgeLength=0.0001, MinTolerance=0, Refine=True, RefineAngle=0, RelativeTolerance=0.65, SimplePlanes=True, Tolerance=0})
context_bake = ContextBake(Geometry=mesh_brep)
context_bake_2 = ContextBake(Geometry=curve)
